# Dynamo graph getRevitNodes.dyn (Dynamo 2.18.1.5096)
# packages: Rhythm 2023.9.1

string = StringInput("D:\repos_john\DynamoRevit-NodeSamples\src\_workingFiles\{0}.xlsx")
python_script = Python()  # CPython3; unwired: IN[0]
# ---------- python_script.python (27 lines) ----------
# Load the Python Standard and DesignScript Libraries
import sys
import clr
clr.AddReference('DynamoRevitDS')
import Dynamo 
		
# access to the current Dynamo instance and workspace
dynamoRevit = Dynamo.Applications.DynamoRevit()
currentWorkspace = dynamoRevit.RevitDynamoModel.CurrentWorkspace

categories = []
allRevitNodes = []
		
allSearchEntries = dynamoRevit.RevitDynamoViewModel.Model.SearchModel.SearchEntries

for s in allSearchEntries:
    if s.Categories[0] == "Revit":
        categories.append(s.FullCategoryName)
        nodeNameDescription = []
        nodeNameDescription.append(s.Name)
        nodeNameDescription.append(s.Description)
        allRevitNodes.append(nodeNameDescription)
        nodeNameDescription.clear
    

# Assign your output to the OUT variable.
OUT = categories,allRevitNodes
# ----------------------------------------
codeblock = CodeBlock(value=python_script) { value[0]; value[1]; }
groupByKey = List.GroupByKey(list=codeblock.out1, keys=codeblock.out0)
count = List.Count(list=groupByKey.groups@L3)
code_block = CodeBlock(count=count, name=groupByKey.uniqueKeys) { count + "-" + name; }
ʳʰʸᵗʰᵐ_modify_formatwith = Rhythm.String.Modify.FormatWith(str=string, args=code_block, lacing=Longest)
openXMLExportExcel = Data.OpenXMLExportExcel(filePath=ʳʰʸᵗʰᵐ_modify_formatwith, sheetName=groupByKey.uniqueKeys, data=groupByKey.groups)
